# Grasshopper definition 04_thermal_comfort_Gagge_two_node_model.gh (Grasshopper 1.0.8)

bsa_du_bois = BSADuBois(height="175", weight="75")  # -> BSA; inputs height: Double, weight: Double
#   port BSA: Body Surface Area in m2
# ---------- bsa_du_bois: Python ----------
height = 0.0 if height is None or height <= 0 else height
weight = 0.0 if weight is None or weight <= 0 else weight

# BSA (m^2) / height (cm) /  weight (kg)
BSA = 0.007184 * (height ** 0.725) * (weight ** 0.425)
# ---------- end bsa_du_bois ----------
panel = Panel(bsa_du_bois)
gagge_two_node_model = GaggeTwoNodeModel(tdb="25", tr="25", v="0.3", rh="50", met="1.2", clo="0.5", BSA=bsa_du_bois, position="sitting")  # -> e_skin, e_rsw, e_max, q_sensible, q_skin, q_res, t_core, t_skin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; inputs tdb: Double, tr: Double, v: Double, rh: Double, met: Double, clo: Double, wme: Double, BSA: Double, p_atm: Double, position: String, max_skin_blood_flow: Double, max_sweating: Double, w_max: Double
#   port tdb: Dry bulb air temperature, [°C].
#   port tr: Mean radiant temperature, [°C].
#   port v: Air speed, [m/s].
#   port rh: Relative humidity, [%].
#   port met: Metabolic rate, [met].
#   port clo: Clothing insulation, [clo].
#   port wme: External work, [met]. Defaults to 0.
#   port BSA: Body surface area, default value 1.8258 [m2].
#   port p_atm: Atmospheric pressure, default value 101325 [Pa].
#   port position: Select either “sitting” or “standing”. Defaults to “standing”.
#   port max_skin_blood_flow: Maximum blood flow from the core to the skin, [kg/h/m2]. Defaults to 90.
#   port max_sweating: Maximum rate at which regulatory sweat is generated, [kg/h/m2]. Defaults to 500.
#   port w_max: Maximum skin wettedness (w) adimensional. Ranges from 0 and 1. Defaults to False.
#   port e_skin: Total rate of evaporative heat loss from skin, [W/m2]. Equal to e_rsw + e_diff.
#   port e_rsw: Rate of evaporative heat loss from sweat evaporation, [W/m2].
#   port e_max: Maximum rate of evaporative heat loss from skin, [W/m2].
#   port q_sensible: Sensible heat loss from skin, [W/m2].
#   port q_skin: Total rate of heat loss from skin, [W/m2]. Equal to q_sensible + e_skin.
#   port q_res: Total rate of heat loss through respiration, [W/m2].
#   port t_core: Core temperature, [°C].
#   port t_skin: Skin temperature, [°C].
#   port m_bl: Skin blood flow, [kg/h/m2].
#   port m_rsw: Rate at which regulatory sweat is generated, [mL/h/m2].
#   port w: Skin wettedness, adimensional. Ranges from 0 to 1.
#   port w_max: Skin wettedness (w) practical upper limit, adimensional. Ranges from 0 to 1.
#   port SET: Standard Effective Temperature (SET).
#   port ET: New Effective Temperature (ET).
#   port pmv_gagge: PMV Gagge: Gagge’s version of Fanger’s Predicted Mean Vote (PMV).
#   port disc: Thermal discomfort (DISC). DISC is described numerically as: comfortable and pleasant (0), slightly uncomfortable but acceptable (1), uncomfortable and unpleasant (2), very uncomfortable (3), limited tolerance (4), and intolerable (5). The range of each category is ± 0.5 numerically.
#   port t_sens: Predicted Thermal Sensation.
# ---------- gagge_two_node_model: Python ----------
from carbonfly.pythermalcomfort.models import two_nodes_gagge

result = two_nodes_gagge(
    tdb=tdb, 
    tr=tr, 
    v=v, 
    rh=rh, 
    met=met, 
    clo=clo, 
    wme=wme or 0, 
    body_surface_area=BSA or 1.8258, 
    p_atm=p_atm or 101325, 
    position=position or "standing", 
    max_skin_blood_flow=max_skin_blood_flow or 90, 
    max_sweating=max_sweating or 500, 
    w_max=w_max or False
)

e_skin = result["e_skin"]
e_rsw = result["e_rsw"]
e_max = result["e_max"]
q_sensible = result["q_sensible"]
q_skin = result["q_skin"]
q_res = result["q_res"]
t_core = result["t_core"]
t_skin = result["t_skin"]
m_bl = result["m_bl"]
m_rsw = result["m_rsw"]
w = result["w"]
w_max = result["w_max"]
SET = result["set"]
ET = result["et"]
pmv_gagge = result["pmv_gagge"]
pmv_set = result["pmv_set"]
disc = result["disc"]
t_sens = result["t_sens"]
# ---------- end gagge_two_node_model ----------
panel_2 = Panel(gagge_two_node_model.e_skin)
panel_3 = Panel(gagge_two_node_model.e_rsw)
panel_4 = Panel(gagge_two_node_model.e_max)
panel_5 = Panel(gagge_two_node_model.q_sensible)
panel_6 = Panel(gagge_two_node_model.q_skin)
panel_7 = Panel(gagge_two_node_model.q_res)
panel_8 = Panel(gagge_two_node_model.t_core)
panel_9 = Panel(gagge_two_node_model.m_bl)
panel_10 = Panel(gagge_two_node_model.m_rsw)
panel_11 = Panel(gagge_two_node_model.w)
panel_12 = Panel(gagge_two_node_model.w_max)
panel_13 = Panel(gagge_two_node_model.SET)
panel_14 = Panel(gagge_two_node_model.ET)
panel_15 = Panel(gagge_two_node_model.pmv_gagge)
panel_16 = Panel(gagge_two_node_model.pmv_set)
panel_17 = Panel(gagge_two_node_model.disc)
panel_18 = Panel(gagge_two_node_model.t_sens)
# Skin temperature can be used for simulation
panel_19 = Panel(gagge_two_node_model.t_skin)
